# Grasshopper definition 00_Rationalization.gh (Grasshopper 1.0.7)

# ----
# RATIONALIZATION
srf = Surface(<surface referenced from the Rhino model>)
number_slider = Slider(100, range=0..500)
dim = Dimensions(Surface=srf)  # -> UDimension, VDimension
division = Division(A=dim.VDimension, B=dim.UDimension)
multiplication = Multiplication(A=number_slider, B=division)
sdivide = DivideSurface(Surface=srf, UCount=number_slider, VCount=multiplication)  # -> Points, Normals, Parameters
mesh = Mesh(<mesh referenced from the Rhino model>)
project = ProjectPoint(Point=flatten(sdivide.Points), Direction=Vector(0, 0, -1), Geometry=mesh)  # -> Point, Index
srfgrid = SurfaceFromPoints(Points=project.Point, UCount=expr("x+1", number_slider), Interpolate=False)
