# Grasshopper definition 01_Level Curves.gh (Grasshopper 1.0.7)

# ----
# LEVEL CURVES
data = Data(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)
bbox = BoundingBox(Content=data, Plane=PlaneXY(0, 0, 0))  # -> Box, Box_2
edges = BrepEdges(Brep=bbox.Box)  # -> Naked, Interior, NonManifold
sort = SortList(Keys=edges.Interior, ValuesA=edges.Interior)  # -> Keys, ValuesA
item = ListItem(List=sort.ValuesA, Index=0, Wrap=True)  # -> Item1, Item
len = Length(Curve=item.Item1)
division = Division(A=len, B=Slider(0.5, range=0..100))
pframes = PerpFrames(Curve=item.Item1, Count=division, Align=True)  # -> Frames, Parameters
panel = Panel(len)
sec = BrepPlane(Brep=data, Plane=pframes.Frames)  # -> Curves, Points
