# Grasshopper definition 02_Mesh Mapping.gh (Grasshopper 1.0.7)

# ----
# DATA IMPORT
# Input the data file (Data.csv) folder location here!
panel = Panel("C:\Users\menatj\Dropbox\00_TOMAS\00_PC\01_Work\03_Academic\Umea\Sem02_2022\Seminar description\Grasshopper Examples\OneDrive_2022-10-18\Rhino-Grasshopper Examples_220414\Data.csv")

srf = Surface(<surface referenced from the Rhino model>)

# ----
# DATA GENERATION
number_slider = Slider(12, range=0..100)
number_slider_2 = Slider(28, range=0..100)
random = Random(Range=number_slider_2, Number=number_slider, Seed=Slider(1, range=0..1))
random_2 = Random(Range=number_slider_2, Number=number_slider, Seed=2)
panel_2 = Panel(random)
panel_3 = Panel(random_2)
concat = Concatenate(FragmentA=panel_3, FragmentB=",", FragmentC=panel_2)

# ----
# RATIONALIZATION
number_slider_3 = Slider(100, range=0..500)
dim = Dimensions(Surface=srf)  # -> UDimension, VDimension
division = Division(A=dim.VDimension, B=dim.UDimension)
multiplication = Multiplication(A=number_slider_3, B=division)
mesh = Mesh(<mesh referenced from the Rhino model>)
sdivide = DivideSurface(Surface=srf, UCount=number_slider_3, VCount=multiplication)  # -> Points, Normals, Parameters
project = ProjectPoint(Point=flatten(sdivide.Points), Direction=Vector(0, 0, -1), Geometry=mesh)  # -> Point, Index
srfgrid = SurfaceFromPoints(Points=project.Point, UCount=expr("x+1", number_slider_3), Interpolate=False)

file = ReadFile(File=panel, PerLineParse=True)
split = TextSplit(Text=file, Separators=",")
item = ListItem(List=split, Index=0, Wrap=True)  # -> flatten(Item), flatten(Item1)

panel_4 = Panel(item.Item1)
# REMAPPING
panel_5 = Panel(item.Item)
sort = SortList(Keys=panel_4)  # -> Keys, ValuesA
sort_2 = SortList(Keys=panel_5)  # -> Keys, ValuesA
item_2 = ListItem(List=sort.Keys, Index=0, Wrap=True)  # -> Item1, Item
item_3 = ListItem(List=sort_2.Keys, Index=0, Wrap=True)  # -> Item1, Item
dom = ConstructDomain(DomainStart=item_2.Item, DomainEnd=item_2.Item1)
dom_2 = ConstructDomain(DomainStart=item_3.Item, DomainEnd=item_3.Item1)
dom_3 = ConstructDomain(DomainStart="0", DomainEnd=".99")
remap = RemapNumbers(Value=panel_5, Source=dom_2, Target=dom_3)  # -> Mapped, Clipped
remap_2 = RemapNumbers(Value=panel_4, Source=dom, Target=dom_3)  # -> Mapped, Clipped
concat_2 = Concatenate(FragmentA=remap.Mapped, FragmentB=",", FragmentC=remap_2.Mapped)

# ----
# Keep In Mind: Right click on the panel to set stream destination.
# 
# After destination is assigned as ".csv" file, right click and press "Stream Content"
panel_6 = Panel(concat)

# ----
# POINT
md_slider = MDSlider(
    SliderMode=0,
    slider_value=Point(0.8445339203, 0.3721389771, 0.5),
    x_domain=Domain(0, 1),
    y_domain=Domain(0, 1),
    z_domain=Domain(0, 1))
evalsrf = EvaluateSurface(Surface=reparameterize(srfgrid), Point=md_slider)  # -> Point, Normal, UDirection, VDirection, Frame

evalsrf_2 = EvaluateSurface(Surface=reparameterize(srfgrid), Point=concat_2)  # -> Point, Normal, UDirection, VDirection, Frame

# ----
# MESH MAPPING
divide = DivideDomain²(Domain=srfgrid, UCount=number_slider_3, VCount=multiplication)
subsrf = Isotrim(Surface=srfgrid, Domain=divide)
area = Area(Geometry=subsrf)  # -> Area, Centroid
srf_cp = SurfaceClosestPoint(Point=area.Centroid, Surface=subsrf)  # -> Point, UVPoint, Distance
number_slider_4 = Slider(30, range=0..100)
evalsrf_3 = EvaluateSurface(Surface=subsrf, Point=srf_cp.UVPoint)  # -> Point, Normal, UDirection, VDirection, Frame
dist = Distance(PointA=evalsrf_3.Point, PointB=evalsrf_2.Point)
dom_4 = ConstructDomain(DomainStart=0, DomainEnd=number_slider_4)
amp = Amplitude(Vector=evalsrf_3.Normal, Amplitude=dist)
bnd = Bounds(Numbers=dist)
dedomain = DeconstructDomain(Domain=bnd)  # -> Start, End
remap_3 = RemapNumbers(Value=dist, Source=bnd, Target=dom_4)  # -> Mapped, Clipped
Z = UnitZ(Factor=remap_3.Mapped)
Z_2 = UnitZ(Factor=number_slider_4)
rev = Reverse(Vector=Z)
gradient = Gradient(
    LowerLimit=dedomain.Start,
    UpperLimit=dedomain.End,
    Parameter=dist,
    stops=[0.265: RGB(255, 130, 160), 0.448: RGB(159, 61, 43), 0.542: RGB(220, 0, 40)])
move = Move(Geometry=subsrf, Motion=rev)  # -> Geometry, Transform
move_2 = Move(Geometry=move.Geometry, Motion=Z_2)  # -> Geometry, Transform
preview = CustomPreview(Geometry=move_2.Geometry, Material=gradient)
