# Grasshopper definition Particle_Spring_Example.gh (Grasshopper 1.0.7)
# plug-ins: Kangaroo2 Components

panel = Panel("0.2")
Z = UnitZ(Factor=1)
rev = Reverse(Vector=Z)

circle = Data(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)
number_slider = Slider(3.33, range=0..10)
division = Division(A=Slider(10, range=0..10), B=Slider(3, range=0..10))

scale = Scale(Geometry=circle, Center=Point(0, 0, 0), Factor="1")  # -> Geometry, Transform
boundary = BoundarySurfaces(Edges=scale.Geometry)
mesh = MeshBrep(
    Brep=boundary,
    Settings={GridMaxCount=0, GridMinCount=16, JaggedSeams=False, MaxEdgeLength=0, MinEdgeLength=0.0001, MinTolerance=0, Refine=True, RefineAngle=0, RelativeTolerance=0.65, SimplePlanes=True, Tolerance=0})
popgeo = PopulateGeometry(Geometry=boundary, Count=500, Seed=1)
load = Load(Point=popgeo, ForceVector=Z, Weighting=10000)

divide = DivideCurve(Curve=scale.Geometry, Count=50, Kinks=False)  # -> simplify(Points), Tangents, Parameters

del = DelaunayMesh(Points=[divide.Points, popgeo], Plane=PlaneXY(0, 0, 0))
medges = MeshEdges(Mesh=del)  # -> NakedEdges, InteriorEdges, NonManifoldEdges
edgelengths = EdgeLengths(Mesh=del, LengthFactor=0, Strength=100)
pressure = Pressure(M=del, Strength=0.12)  # disabled

data = Data([medges.InteriorEdges, medges.NakedEdges])
len = Length(Curve=data)

anchor = Anchor(Point=flatten(divide.Points), Strength=10000)
length_line = LengthLine(Line=data, Length=len, Strength=100)
show = Show(G=del)
entwine = Entwine(
    Branch00=anchor,
    Branch01=length_line,
    Branch02=load,
    Branch03=show,
    Branch04=edgelengths,
    Branch05=pressure,
    FlattenInputs=True)  # -> flatten(Result)
bouncysolver = BouncySolver(
    GoalObjects=flatten(entwine),
    Reset=Button(),
    Threshold=1e-15,
    Tolerance=0.0001,
    Damping=0.99,
    Iterations=10,
    On=Toggle(False))  # -> I, V, O

panel_2 = Panel(bouncysolver.O)
scale_2 = Scale(Geometry=bouncysolver.O, Center=Point(0, 0, 0), Factor=division)  # -> Geometry, Transform
