# Grasshopper definition Surface_rationalization_Alexandra.gh (Grasshopper 1.0.7)

# ---- group: Mesh Topography input
mesh = Mesh(<mesh referenced from the Rhino model>)

# ----
bbox = BoundingBox(Content=mesh, Plane=PlaneXY(0, 0, 0), UnionBox=True)  # -> Box, Box_2
debrep = DeconstructBrep(Brep=bbox.Box)  # -> Faces, Edges, Vertices
area = Area(Geometry=debrep.Faces)  # -> Area, Centroid
pdecon = Deconstruct(Point=area.Centroid)  # -> XComponent, YComponent, ZComponent
sort = SortList(Keys=pdecon.ZComponent, ValuesA=debrep.Faces, ValuesB=area.Centroid)  # -> Keys, reverse(ValuesA), reverse(ValuesB)
item = ListItem(List=sort.ValuesA, Index=0, Wrap=True)
item_2 = ListItem(List=sort.ValuesB, Index=0, Wrap=True)
scale = Scale(Geometry=item, Center=item_2, Factor=0.99)  # -> Geometry, Transform
dim = Dimensions(Surface=scale.Geometry)  # -> UDimension, VDimension
number_slider = Slider(200, range=0..300)
division = Division(A=dim.UDimension, B=dim.VDimension)
Z = UnitZ(Factor=Slider(100000, range=0..100000))
multiplication = Multiplication(A=number_slider, B=division)
move = Move(Geometry=scale.Geometry, Motion=Z)  # -> Geometry, Transform
round = Round(Number=multiplication)  # -> Nearest, Floor, Ceiling
sdivide = DivideSurface(Surface=move.Geometry, UCount=round.Floor, VCount=number_slider)  # -> flatten(Points), Normals, Parameters
project = ProjectPoint(Point=sdivide.Points, Direction=Vector(0, 0, -1), Geometry=mesh)  # -> Point, Index
null = NullItem(Item=project.Point)  # -> NullFlags, InvalidFlags, Description
dispatch = Dispatch(List=project.Point, DispatchPattern=null.NullFlags)  # -> ListA, ListB
data = Data(dispatch.ListB)
srfgrid = SurfaceFromPoints(Points=data, UCount=expr("X+1", round.Floor), Interpolate=False)

# ---- group: Terrain Segment Curve
terrain_section = Curve(<curve referenced from the Rhino model>)

# ----
project_2 = Project(Curve=terrain_section, Brep=srfgrid, Direction=Vector(0, 0, 1))
srfsplit = SurfaceSplit(Surface=srfgrid, Curves=project_2)
sort_2 = SortList(Keys=srfsplit, ValuesA=srfsplit)  # -> Keys, ValuesA

# ---- group: Terrain Segment surface
item_3 = ListItem(List=sort_2.ValuesA, Index=0, Wrap=True)
