# Grasshopper definition Denis.gh (Grasshopper 1.0.7)
# plug-ins: Human

# ---- group: Fields
crv = Curve([<curve referenced from the Rhino model> x7])

# ----
topo = Surface(<surface referenced from the Rhino model>)
project = Project(Curve=crv, Brep=topo, Direction=Vector(0, 0, 1))

# ---- group: River
crv_2 = Curve(<curve referenced from the Rhino model>)

# ----
bbox = BoundingBox(Content=project, Plane=PlaneXY(0, 0, 0))  # -> flatten(Box), Box_2
area = Area(Geometry=bbox.Box)  # -> Area, Centroid
crv_cp = CurveClosestPoint(Point=area.Centroid, Curve=crv_2)  # -> Point, Parameter, Distance
points = PointList(Points=area.Centroid)
ln = Line(StartPoint=area.Centroid, EndPoint=crv_cp.Point)
points_2 = PointList(Points=crv_cp.Point, Size=5)
project_2 = Project(Curve=ln, Brep=topo, Direction=Vector(0, 0, 1))  # -> flatten(Curve)
len = Length(Curve=project_2)
panel = Panel(project_2)
panel_2 = Panel(len)
sort = SortList(Keys=panel_2)  # -> Keys, ValuesA
panel_3 = Panel(sort.Keys)
item = ListItem(List=sort.Keys, Index=Slider(2, range=0..10), Wrap=True)  # -> Item1, Item, Item1_2, Item2
item_2 = ListItem(List=sort.Keys, Index=0, Wrap=True)  # -> Item1, Item
panel_4 = Panel(item.Item)
panel_5 = Panel(item_2.Item1)
panel_6 = Panel(item_2.Item)
data = Data(project_2)
gradient = Gradient(
    LowerLimit=panel_6,
    UpperLimit=panel_5,
    Parameter=panel_3,
    stops=[0: RGB(234, 38, 0), 0.177: RGB(234, 126, 0), 0.385: RGB(254, 244, 84), 0.622: RGB(173, 203, 249), 0.777: RGB(75, 107, 169)])
preview = CustomPreview(Geometry=data, Material=gradient)
previewlw = CustomPreviewLineweights(Geometry=data, Shader=gradient, Thickness=Slider(5, range=0..100), Absolute=False)
