# Grasshopper definition Trees.gh (Grasshopper 1.0.7)

# ----
# Please!! Reference Palsa areas!
crv = Curve([<curve referenced from the Rhino model> x1133])

# ---- group: Amount of selected Areas
panel = Panel("200")

# ----
sort = SortList(Keys=crv, ValuesA=crv)  # -> Keys, reverse(ValuesA)
series = Series(Start=0, Step=1, Count=panel)

# ---- group: Controls elevation of points
number_slider = Slider(6, range=0..10)

# ----
item = ListItem(List=sort.ValuesA, Index=series, Wrap=True)
Z = UnitZ(Factor=number_slider)
pop2d = Populate2D(Region=item, Count=200, Seed=1)

# ----
# Reference the Topography!!
mesh = Mesh(<mesh referenced from the Rhino model>)

move = Move(Geometry=pop2d, Motion=Z)  # -> Geometry, Transform

# ---- group: Total elevation op points
panel_2 = Panel("0.5")

# ----
project = ProjectPoint(Point=move.Geometry, Direction=Vector(0, 0, -1), Geometry=mesh)  # -> Point, Index
dom = ConstructDomain(DomainStart=0, DomainEnd=panel_2)
lng = ListLength(List=project.Point)
random = Random(Range=dom, Number=lng, Seed=2)
panel_3 = Panel(random)
Z_2 = UnitZ(Factor=panel_3)
move_2 = Move(Geometry=project.Point, Motion=Z_2)  # -> Geometry, Transform

# ---- group: Trees!
ln = Line(StartPoint=move_2.Geometry, EndPoint=project.Point)
