# Grasshopper definition Brics.gh (Grasshopper 1.0.7)

surface = Surface(<surface referenced from the Rhino model>)
bounding_box = BoundingBox(Content=surface, Plane=PlaneXY(0, 0, 0))  # -> Box, Box_2
brep_edges = BrepEdges(Brep=bounding_box.Box)  # -> Naked, Interior, NonManifold
deconstruct_vector = DeconstructVector(Vector=brep_edges.Interior)  # -> XComponent, YComponent, ZComponent
panel = Panel(deconstruct_vector.ZComponent)
dispatch = Dispatch(List=brep_edges.Interior, DispatchPattern=panel)  # -> ListA, ListB
data = Data(dispatch.ListA)
list_item = ListItem(List=data, Index=0, Wrap=True)
length = Length(Curve=list_item)
panel_2 = Panel(length)
division = Division(A=panel_2, B="0.8")
panel_3 = Panel(division)
divide_curve = DivideCurve(Curve=list_item, Count=panel_3, Kinks=False)  # -> Points, Tangents, Parameters
xy_plane = XYPlane(Origin=divide_curve.Points)
brep_plane = BrepPlane(Brep=surface, Plane=xy_plane)  # -> flatten(Curves), Points
panel_4 = Panel("""0
1""")
dispatch_2 = Dispatch(List=brep_plane.Curves, DispatchPattern=panel_4)  # -> ListA, ListB
data_2 = Data(dispatch_2.ListA)
data_3 = Data(dispatch_2.ListB)
length_2 = Length(Curve=data_2)
panel_5 = Panel(length_2)
division_2 = Division(A=panel_5, B="1.8")
round = Round(Number=division_2)  # -> Nearest, Floor, Ceiling
multiplication = Multiplication(A=round.Nearest, B="2")
divide_curve_2 = DivideCurve(Curve=data_3, Count=multiplication, Kinks=False)  # -> Points, Tangents, Parameters
divide_curve_3 = DivideCurve(Curve=data_2, Count=division_2, Kinks=False)  # -> Points, Tangents, Parameters

# ---- group: Tree Data Structure
param_viewer = ParamViewer(divide_curve_3.Points)
param_viewer_2 = ParamViewer(divide_curve_3.Points)

# ----
panel_6 = Panel("""0
1""")
dispatch_3 = Dispatch(List=divide_curve_2.Points, DispatchPattern=panel_6)  # -> ListA, ListB
data_4 = Data(dispatch_3.ListA)
surface_2 = Surface(<surface referenced from the Rhino model>)
merge = Merge(Data1=divide_curve_3.Points, Data2=data_4)
surface_closest_point = SurfaceClosestPoint(Point=merge, Surface=surface_2)  # -> Point, UVPoint, Distance
evaluate_surface = EvaluateSurface(Surface=surface_2, Point=surface_closest_point.UVPoint)  # -> Point, Normal, UDirection, VDirection, Frame

# ---- group: BRICK
y_size = YSize(Domain(-2, 2))
x_size = XSize(Domain(-1, 1))
plane = Plane(PlaneXY(0, 0, 0))
rectangle = Rectangle(Plane=plane, XSize=y_size, YSize=x_size, Radius=0)  # -> Rectangle, Length
scale = Scale(Geometry=rectangle.Rectangle, Center=Point(0, 0, 0), Factor=0.2)  # -> Geometry, Transform
data_5 = Data(scale.Geometry)
orient = Orient(Geometry=data_5, Source=plane, Target=evaluate_surface.Frame)  # -> Geometry, Transform

# ----
amplitude = Amplitude(Vector=evaluate_surface.Normal, Amplitude=Slider(0.6, range=0..10))
extrude = Extrude(Base=orient.Geometry, Direction=amplitude)
cap_holes = CapHoles(Brep=extrude)
